# Grasshopper definition KarambaIDEA_Truss_Example.gh (Grasshopper 1.0.7)
# Copyright: B+G Engineers
# plug-ins: Karamba3D, KarambaIDEA

# ---- group: Truss Splices
splice_2 = Slider(0.791, range=0..1)
splice_1 = Slider(0.214, range=0..1)
merge = Merge(Data1=splice_1, Data2=splice_2)

# ----
splice_2_2 = Slider(0.542, range=0..1)

# ---- group: Geometry Input
kink_location = Slider(0.281, range=0.1..0.4)
length = Slider(25, range=0..30)
truss_divisions = Slider(12, range=2..20)
structure_height = Slider(4, range=0..10)
truss_height = Slider(1.7, range=0..5)
kink_height = Slider(0.5, range=0..1)

# ----
unit_x = UnitX(Factor=length)
multiplication = Multiplication(A=truss_height, B=kink_height)
point = Point(Point(0, 0, 0))
move = Move(Geometry=point, Motion=unit_x)  # -> Geometry, Transform
negative = Negative(Value=truss_height)
negative_2 = Negative(Value=multiplication)
line = Line(StartPoint=point, EndPoint=move.Geometry)
unit_z = UnitZ(Factor=negative_2)
unit_z_2 = UnitZ(Factor=negative)
unit_z_3 = UnitZ(Factor=structure_height)
aligned_dimension = AlignedDimension(Plane=PlaneXY(0, 0, 0), PointA=point, PointB=move.Geometry, Offset=-1, Text="{0:0.00}", Size=0.2)
move_2 = Move(Geometry=line, Motion=unit_z_3)  # -> Geometry, Transform
move_3 = Move(Geometry=move_2.Geometry, Motion=unit_z_2)  # -> Geometry, Transform
length_2 = Length(Curve=move_3.Geometry)
multiplication_2 = Multiplication(A=kink_location, B=length_2)
divide_curve = DivideCurve(Curve=move_2.Geometry, Count=truss_divisions, Kinks=False)  # -> Points, Tangents, Parameters
extend_curve = ExtendCurve(Curve=move_2.Geometry, Type=0, Start=expr("x*-1", multiplication_2), End=expr("x*-1", multiplication_2))
list_item = ListItem(List=divide_curve.Points, Index=0, Wrap=True)  # -> Item1, Item
perp_frame = PerpFrame(Curve=move_2.Geometry, Parameter=merge)
merge_2 = Merge(Data1=list_item.Item, Data2=list_item.Item1)
end_points = EndPoints(Curve=extend_curve)  # -> Start, End
move_4 = Move(Geometry=merge_2, Motion=unit_z)  # -> Geometry, Transform
distance = Distance(PointA=graft([end_points.Start, end_points.End]), PointB=divide_curve.Points)
list_item_2 = ListItem(List=move_4.Geometry, Index=0, Wrap=True)  # -> Item, Item1
end_points_2 = EndPoints(Curve=line)  # -> Start, End
sort_list = SortList(Keys=distance, ValuesValuesA=divide_curve.Points)  # -> Keys, ValuesValuesA
merge_3 = Merge(Data1=end_points_2.Start, Data2=end_points_2.End)
list_item_3 = ListItem(List=sort_list.ValuesValuesA, Index=0, Wrap=True)  # -> flatten(Item)
move_5 = Move(Geometry=list_item_3, Motion=unit_z_2)  # -> Geometry, Transform
merge_4 = Merge(Data1=flatten(list_item_2.Item), Data2=flatten(move_5.Geometry), Data3=flatten(list_item_2.Item1))
unit_z_4 = UnitZ(Factor=-1)
polyline = PolyLine(Vertices=merge_4, Closed=False)
project_point = ProjectPoint(Point=divide_curve.Points, Direction=unit_z_4, Geometry=polyline)  # -> Point, Index
point_2 = Point(merge_3)
line_2 = Line(StartPoint=divide_curve.Points, EndPoint=project_point.Point)
line_3 = Line(StartPoint=move_4.Geometry, EndPoint=point_2)
list_length = ListLength(List=line_2)  # -> expr("x-1", Length)
end_points_3 = EndPoints(Curve=line_2)  # -> Start, End
series = Series(Start=list_length, Step="-1", Count=expr("x/2+1", list_length))
series_2 = Series(Start=0, Step="1", Count=expr("x/2+1", list_length))
entwine = Entwine(Branch00=end_points_3.Start, Branch01=end_points_3.End, FlattenInputs=True)  # -> simplify(Result)
panel = Panel("""0
-1""")
cull_index = CullIndex(List=line_2, Indices=panel, Wrap=True)
polyline_2 = PolyLine(Vertices=entwine, Closed=False)
list_item_4 = ListItem(List=line_2, Index=panel, Wrap=True)
list_item_5 = ListItem(List=line_2, Index=series, Wrap=True)
list_item_6 = ListItem(List=line_2, Index=series_2, Wrap=True)
explode = Explode(Curve=polyline_2, Recursive=True)  # -> Segments, Vertices
curve_plane = CurvePlane(Curve=simplify(polyline_2), Plane=perp_frame)  # -> Points, ParamsC, ParamsP
entwine_2 = Entwine(Branch00=list_item_5, Branch01=list_item_6, FlattenInputs=True)
merge_5 = Merge(Data1=list_item_4, Data2=line_3)
end_points_4 = EndPoints(Curve=entwine_2)  # -> Start, End
path_mapper = PathMapper(curve_plane.Points, source="{A;B}", target="{A}")
merge_6 = Merge(Data1=simplify(explode.Vertices), Data2=simplify(path_mapper))
sort_along_curve = SortAlongCurve(Points=merge_6, Curve=polyline_2)  # -> Points, Indices
shift_list = ShiftList(List=end_points_4.Start, Shift="-1", Wrap=False)
shift_list_2 = ShiftList(List=end_points_4.End, Shift="1", Wrap=False)
line_4 = Line(StartPoint=shift_list, EndPoint=shift_list_2)  # -> flatten(Line)
polyline_3 = PolyLine(Vertices=sort_along_curve.Points, Closed=False)
curve_plane_2 = CurvePlane(Curve=simplify(graft(line_4)), Plane=perp_frame)  # -> Points, ParamsC, ParamsP
unit_x_2 = UnitX(Factor=1)
explode_tree = ExplodeTree(Data=polyline_3)  # -> Branch0, Branch1
explode_2 = Explode(Curve=explode_tree.Branch1, Recursive=True)  # -> Segments, Vertices
path_mapper_2 = PathMapper(curve_plane_2.Points, source="{A;B}", target="{A}")
vector = Vector(explode_2.Segments)
explode_3 = Explode(Curve=explode_tree.Branch0, Recursive=True)  # -> Segments, Vertices
dot_product = DotProduct(VectorA=unit_x_2, VectorB=vector, Unitize=False)
list_length_2 = ListLength(List=path_mapper_2)
larger_than = LargerThan(FirstNumber=list_length_2, SecondNumber="0")  # -> flatten(LargerThan), OrEqualTo
smaller_than = SmallerThan(FirstNumber=dot_product, SecondNumber="1")  # -> SmallerThan, OrEqualTo
dispatch = Dispatch(List=explode_2.Segments, DispatchPattern=smaller_than.SmallerThan)  # -> ListA, ListB
dispatch_2 = Dispatch(List=line_4, DispatchPattern=larger_than.LargerThan)  # -> ListA, ListB
curve = Curve(dispatch_2.ListA)
entwine_3 = Entwine(
    Branch00=merge_5,
    Branch01=explode_3.Segments,
    Branch02=dispatch.ListB,
    Branch03=dispatch.ListA,
    Branch04=cull_index,
    Branch05=dispatch_2.ListB,
    Branch06=curve,
    FlattenInputs=True)

# ---- group: Karamba3D / Define Materials
material_selection_karamba3d = MaterialSelectionKaramba3D(menu=[dropdown(1), dropdown(4)])

# ---- group: Karamba3D / Define Cross Sections
cross_section_range_selector_karamba3d = CrossSectionRangeSelectorKaramba3D(
    MaximumHeight_cm=-1,
    MaximumWidth_cm=-1,
    Material=material_selection_karamba3d,
    menu=[dropdown(1), dropdown(3), dropdown(4)])
cross_section_selector_karamba3d = CrossSectionSelectorKaramba3D(CrossSections=cross_section_range_selector_karamba3d)  # -> CrossSection, Info
cross_section_selector_karamba3d_2 = CrossSectionSelectorKaramba3D(CrossSections=cross_section_range_selector_karamba3d)  # -> CrossSection, Info
cross_section_selector_karamba3d_3 = CrossSectionSelectorKaramba3D(CrossSections=cross_section_range_selector_karamba3d)  # -> CrossSection, Info
entwine_4 = Entwine(
    Branch00=cross_section_selector_karamba3d.CrossSection,
    Branch01=cross_section_selector_karamba3d_2.CrossSection,
    Branch02=cross_section_selector_karamba3d_2.CrossSection,
    Branch03=cross_section_selector_karamba3d_2.CrossSection,
    Branch04=cross_section_selector_karamba3d_3.CrossSection,
    Branch05=cross_section_selector_karamba3d_3.CrossSection,
    Branch06=cross_section_selector_karamba3d_3.CrossSection,
    FlattenInputs=True)
cross_section_karamba3d = CrossSectionKaramba3D(cross_section_range_selector_karamba3d)

# ---- group: Karamba3D / Define Loads
load_multiplier = Slider(20, range=0..500)
unit_z_5 = UnitZ(Factor=load_multiplier)
beam_loads = BeamLoadsKaramba3D(
    BeamIdentifier="Topchord",
    LoadCase="1",
    ForceVector=unit_z_5,
    TStart=0,
    TEnd=1,
    mode="Block",
    menu=[buttons(on, off, off)])

load_multiplier_2 = Slider(-50, range=-100..0)
unit_z_6 = UnitZ(Factor=load_multiplier_2)
beam_loads_2 = BeamLoadsKaramba3D(
    BeamIdentifier="Topchord",
    LoadCase="0",
    ForceVector=unit_z_6,
    TStart=0,
    TEnd=1,
    mode="Block",
    menu=[buttons(on, off, off)])

# ---- group: Karamba3D / Define Supports
panel_2 = Panel("""Diagonal
DiagonalSplice""")
beam_joints_karamba3d = BeamJointsKaramba(
    ElementIdentifiers=panel_2,
    CtKNMAtStartingNode=Vector(0, 0, 0),
    CrKNmRadAtStartingNode=Vector(0, 0, 0),
    CtKNMAtEndNode=Vector(0, 0, 0),
    CrKNmRadAtEndNode=Vector(0, 0, 0),
    menu=[buttons(off, off, off, off, on, off), buttons(off, off, off, off, on, off)])

# ---- group: Karamba3D
line_5 = Line(entwine_3)
point_3 = Point(point_2)
joint_karamba3d = JointKaramba3D(beam_joints_karamba3d)
load_karamba3d = LoadKaramba3D([beam_loads, beam_loads_2])

# ---- group: Karamba3D / Define Elements
panel_3 = Panel("""Column
Topchord
Bottomchord
Kinkchord
Post
Diagonal
Splice""")
line_to_beam_karamba3d = LineToBeamKaramba3D(
    Line=line_5,
    Identifier=graft(panel_3),
    CrossSection=entwine_4,
    New=True,
    Remove=True,
    LimitDistance_m=0.005,
    Bending=True,
    SetBucklingLength=True,
    ToPolylineMaxAngle=0.03,
    ToPolylineTolerance=0.01,
    ToPolylineMinEdgeLength=0.25)  # -> Element, Points, Info

# ---- group: Karamba3D / Define Supports
point_4 = Point(point_3)
support_karamba3d = SupportKaramba3D(PosInd=point_4, menu=[buttons(on, on, on, on, off, off)])

# ----
license_karamba3d = LicenseKaramba3D()
panel_4 = Panel(license_karamba3d)

# ---- group: Karamba3D
element_karamba3d = ElementKaramba3D(line_to_beam_karamba3d.Element)
load_karamba3d_2 = LoadKaramba3D(load_karamba3d)
joint_karamba3d_2 = JointKaramba3D(joint_karamba3d)
support_karamba3d_2 = SupportKaramba3D(support_karamba3d)

# ---- group: Karamba3D / Assemble Model
assemble_model_karamba3d = AssembleModelKaramba3D(
    Elem=flatten(element_karamba3d),
    Support=flatten(support_karamba3d_2),
    Load=flatten(load_karamba3d_2),
    Joint=flatten(joint_karamba3d_2),
    LimitDistance_m=0.005)  # -> Model, Info, Mass_kg, CenterOfGravity, LoadCaseNames

# ---- group: Karamba3D / Optimize Crosssections
panel_5 = Panel("""Column
Topchord
Bottomchord
Kinkchord
Post
Diagonal
Splice""")
cross_section_karamba3d_2 = CrossSectionKaramba3D(cross_section_karamba3d)
optimize_cross_section_karamba3d = OptimizeCrossSectionKaramba3D(
    Model=assemble_model_karamba3d.Model,
    GroupIdentifiers=panel_5,
    CrossSections=cross_section_karamba3d_2,
    MaximumUtilization=1,
    UltimateLimitStateIterations=5,
    DisplacementIterations=5,
    NumberOfSamplePoints=3,
    ElasticDesign=True,
    GammaM0=1,
    GammaM1=1.1,
    SwayFrame=True)  # -> ModelWithOptimizedCrossSections, Info, Mass_kg, MaximumDisplacement_cm, ElasticEnergyChange_kNm

# ---- group: Karamba3D / Analyze Model
analyze_karamba3d = AnalyzeKaramba3D(Model=optimize_cross_section_karamba3d.ModelWithOptimizedCrossSections)  # -> CalculatedModel, MaximumDisplacement_cm, ResultingForceOfGravity_kN, ElasticEnergy_kNm

# ---- group: Karamba3D / View Results
model_view_karamba3d = ModelViewKaramba3D(Model=analyze_karamba3d.CalculatedModel, ResultFactors=1, ResultCase="0")  # -> Model, DeformedMesh, DeformedAxes, DeformedModel
beam_view_karamba3d = BeamViewKaramba3D(Model=model_view_karamba3d.Model)  # -> Model, MeshesOfRenderedBeams, DeformedBeamAxes, LegendColors, LegendTags

# ---- group: 2. Create Project / Stream filter to control data speed
# KarambaIDEA
boolean_toggle = BooleanToggle(True)
stream_filter = StreamFilter(Gate=boolean_toggle, Stream1=beam_view_karamba3d.Model)

# ---- group: 2. Create Project / Data collect
disassemble_model_karamba3d = DisassembleModelKaramba3D(Model=stream_filter)  # -> Model, Point, Beam, Shell, Support, Load, Line, Mesh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
beam_forces_karamba3d = BeamForcesKaramba3D(AnalyzedModel=disassemble_model_karamba3d.Model, Ts=[0, 1])  # -> AnalyzedModel, NormalForce_kN, ShearForceVz_kN, ShearForceVy_kN, TorsionalMomentMt_kNm, BendingMomentMy_kNm, BendingMomentMz_kNm
disassemble_element_karamba3d = DisassembleElementKaramba3D(Element=disassemble_model_karamba3d.Beam)  # -> Element, ElementIdentifier, AxisOfElement, CrossSection, Joint, Material, LocalCoordinateSystem, ElementIsActive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
k3dbeamprops = CSharpScript(
    Model=disassemble_model_karamba3d.Model,
    Reference=["C:\Users\Admin\AppData\Roaming\McNeel\Rhinoceros\packages\7.0\Karamba3D\2.2.0.171\KarambaCommon.dll", "C:\Users\Admin\AppData\Roaming\McNeel\Rhinoceros\packages\7.0\Karamba3D\2.2.0.171\karamba.gha"])  # -> BeamIds, Material, CrosecNames, CrosecShapes, Heights, Widths, TFlanges, TWebs, FRads
# ---------- k3dbeamprops: C# usings ----------
using Karamba.Elements;
using Karamba.CrossSections;
# ---------- k3dbeamprops: C# ----------
    var model = Model as Karamba.Models.Model;
    if (model == null) {
      throw new ArgumentException ("The input is not of type model!");
    }

    var beam_ids = new List<string>();
    var cs_names = new List<string>();
    var cs_shapes = new List<string>();
    var cs_material = new List<string>();
    var heights = new List<double>();
    var widths = new List<double>();
    var tflanges = new List<double>();
    var twebs = new List<double>();
    var frads = new List<double>();

    foreach (var elem in model.elems)
    {
      var beam = elem as ModelElementStraightLine;
      if (beam != null) {
        beam_ids.Add(elem.id);
        cs_names.Add(elem.crosec.name);
        cs_shapes.Add(elem.crosec.shape());
        cs_material.Add(elem.crosec.materialName);

        // is it an I-profile?
        var crosec_i = beam.crosec as CroSec_I;
        if (crosec_i != null) {
          heights.Add(crosec_i.getHeight() * 1000);
          // use the upper flange thickness
          widths.Add(crosec_i.uf_width * 1000);
          tflanges.Add(crosec_i.uf_thick * 1000);
          twebs.Add(crosec_i.w_thick * 1000);
          // use the inner fillet radius
          frads.Add(crosec_i.fillet_r * 1000);
          // this would be the outer fillet radius
          // frads.Add(crosec.fillet_r1);
          continue;
        }

        // is it a CHS?
        var crosec_o = beam.crosec as CroSec_Circle;
        if (crosec_o != null) {
          heights.Add(crosec_o.getHeight() * 1000);
          // use the upper flange thickness
          widths.Add(0);
          tflanges.Add(crosec_o.thick * 1000);
          twebs.Add(crosec_o.thick * 1000);
          frads.Add(0);
          continue;
        }

        // options for Box, trapezoid and T-section are not implemented yet
        throw new Exception("Cross section encountered for which no export is implemented");
      }
    }

    BeamIds = beam_ids;
    CrosecNames = cs_names;
    CrosecShapes = cs_shapes;
    Material = cs_material;
    Heights = heights;
    Widths = widths;
    TFlanges = tflanges;
    TWebs = twebs;
    FRads = frads;
# ---------- end k3dbeamprops ----------
vec_cm_to_mm = Vector(expr("x*10", disassemble_element_karamba3d.LocalEccentricity_cm))
hierarchy = Panel("""Column
Topchord
Bottomchord
Kinkchord
Post
Diagonal
Splice""")
create_project = CreateProject(
    Hierarchy=hierarchy,
    Points=disassemble_model_karamba3d.Point,
    Lines=disassemble_model_karamba3d.Line,
    LCSRotations_Deg=disassemble_element_karamba3d.Alpha_deg,
    EccentricityVector=vec_cm_to_mm,
    Groupnames=k3dbeamprops.BeamIds,
    Materials=k3dbeamprops.Material,
    CrossSectionNames=k3dbeamprops.CrosecNames,
    Shapes=k3dbeamprops.CrosecShapes,
    Height=k3dbeamprops.Heights,
    Width=k3dbeamprops.Widths,
    ThicknessFlanges=k3dbeamprops.TFlanges,
    ThicknessWebs=k3dbeamprops.TWebs,
    Radius=k3dbeamprops.FRads,
    N=beam_forces_karamba3d.NormalForce_kN,
    Vz=beam_forces_karamba3d.ShearForceVz_kN,
    Vy=beam_forces_karamba3d.ShearForceVy_kN,
    Mt=beam_forces_karamba3d.TorsionalMomentMt_kNm,
    My=beam_forces_karamba3d.BendingMomentMy_kNm,
    Mz=beam_forces_karamba3d.BendingMomentMz_kNm)

# ----
panel_6 = Panel(create_project)
deconstruct_project = DeconstructProject()  # -> Joints, BrandNames
export_to_modelbim = ExportToModelBIM(Project=create_project, OutputFolder="C:\Data\GrasshopperExample", RunIDEA=Toggle(True))
deconstruct_joint = DeconstructJoint(Joint=deconstruct_project.Joints)  # -> Id, Name, MemberIds, BearingId, ConnectionData, graft(Brand)
data = Data(create_project)

# ----
# Joint Display
point_5 = Point(deconstruct_project.Joints)
panel_7 = Panel("""0.2
-0.2""")
unit_z_7 = UnitZ(Factor=panel_7)
move_6 = Move(Geometry=graft(point_5), Motion=unit_z_7)  # -> Geometry, Transform
list_item_7 = ListItem(List=move_6.Geometry, Index=0, Wrap=True)  # -> Item1, Item
text_tag = TextTag(Location=list_item_7.Item, Text=graft(deconstruct_joint.Id))
text_tag_2 = TextTag(Location=list_item_7.Item1, Text=deconstruct_joint.Brand)

deconstruct_joint_2 = DeconstructJoint(Joint=deconstruct_project.Joints)  # -> Id, Name, MemberIds, BearingId, ConnectionData, graft(Brand)

# ---- group: Map Joints to Trees Based on Brands
create_set = CreateSet(List=flatten(deconstruct_joint.Brand))  # -> Set, graft(Map)
graft_tree = GraftTree(Tree=deconstruct_project.Joints, IncludeEmptyLists=True, IncludeNullItems=True)  # -> simplify(Tree)
list_item_8 = ListItem(List=create_set.Set, Index=create_set.Map, Wrap=True)
tree_statistics = TreeStatistics(Tree=graft_tree)  # -> Paths, Length, Count
construct_path = ConstructPath(Indices=simplify(list_item_8))
replace_paths = ReplacePaths(Data=graft_tree, Search=tree_statistics.Paths, Replace=flatten(construct_path))

# ---- group: 3. Project utilities
# Visualize joints
visualize_joints = VisualizeJoints(Project=data)  # -> JointTypes, Brandnames, Centerpoints
radius = Slider(0.2, range=0.2..0.5)
spread = Slider(10, range=0..100)
move_along_x = Slider(27, range=0..100)
textsize = Slider(0.4, range=0..1)
cluster = Cluster_3(line=visualize_joints.JointTypes, num_2=spread, num=move_along_x, num_3=radius)  # -> P, R
cluster_2 = Cluster_2(G=visualize_joints.Centerpoints, data_3=spread, X=move_along_x)
custom_preview = CustomPreview(Geometry=cluster.P, Material=cluster.R)
xz_plane = XZPlane(Origin=flatten(cluster_2))
data_2 = Data(flatten(deconstruct_joint_2.Brand))
text_tag_3d = TextTag3D(Location=xz_plane, Text=data_2, Size=textsize, Colour=ColourSwatch(SwatchColor=RGB(0, 0, 0)), Justification=7)

# ----
panel_8 = Panel(replace_paths)
folderpath = Panel("C:\Data\GrasshopperExample")

# ---- group: Assign template with parameters
template_filename = Panel("top_chord_welded_template.contemp")
concatenate = Concatenate(FragmentA=folderpath, FragmentB=template_filename, JoinSeparator="\")  # -> graft(Result)
import_idea_template = ImportIDEATemplate(Path=concatenate)
deconstruct_idea_template = DeconstructIDEATemplate(Template=import_idea_template)
idea_template_full = IDEATemplateFull(IDEATemplate=import_idea_template)
panel_9 = Panel(deconstruct_idea_template)

# ----
connection_category = Panel("1145")

# ---- group: Limit joint selection
tree_branch = TreeBranch(Tree=replace_paths, Path=connection_category, MaintainPaths=True)
list_length_3 = ListLength(List=tree_branch)
split_list = SplitList(List=tree_branch, Index=expr("x/2", list_length_3))  # -> ListA, ListB
panel_10 = Panel("""0
-1""")
list_item_9 = ListItem(List=split_list.ListA, Index=panel_10, Wrap=True)

# ----
modify_joint = ModifyJoint(Joint=list_item_9, TemplateAssigns=idea_template_full)
concatenate_2 = Concatenate(FragmentA=folderpath, FragmentB=connection_category, JoinSeparator="\")  # -> graft(Result)
create_idea_file = CreateIDEAFile(Joints=modify_joint, OutputFolder=concatenate_2, RunIDEA=Toggle(False))

# ---- group: Modify parameters
deconstruct_connection = DeconstructConnection(Connection=create_idea_file)  # -> Name, LoadEffects, Parameters, CodeSetup, Filepath
# Calculate ideaCon file
panel_11 = Panel("""False
0.005
0.005""")
panel_12 = Panel("""True
0.006
0.006""")
entwine_5 = Entwine(Branch00=panel_12, Branch01=panel_11, FlattenInputs=True)
set_param_value = SetParamValue(Parameter=deconstruct_connection.Parameters, Value=entwine_5)
panel_13 = Panel(set_param_value)
code_setup = CodeSetup(CodeSetup=deconstruct_connection.CodeSetup, Key="stopAtLimitStrain", Value=Toggle(True))
modify_con_parameters = ModifyConParameters(Parameters=set_param_value)
panel_14 = Panel(code_setup)

# ----
panel_15 = Panel(create_idea_file)
calculate_connection = CalculateConnection(Connection=graft(create_idea_file), Modifications=modify_con_parameters, RunIDEA=Toggle(False))
panel_16 = Panel(calculate_connection)
connection_costs = ConnectionCosts(Connection=calculate_connection)  # -> Name, TotalEstCost, SteelCosts, WeldCosts, BoltCosts, HoleDrillingCost, Messages

# ---- group: Analyses results
connection_results = ConnectionResults(Connection=calculate_connection)  # -> Name, SummaryResults, PlateResults, WeldResults, BoltResults, AnchorResults, ConcreteBlockResults
deconstruct_item_result = DeconstructItemResult(ItemResult=connection_results.SummaryResults)  # -> Name, CheckStatus, UnityCheck, PlMaxStress, PlMaxStrain, Items, ItemId, CheckMsg
deconstruct_item_result_2 = DeconstructItemResult(ItemResult=connection_results.WeldResults)  # -> Name, CheckStatus, UnityCheck, PlMaxStress, PlMaxStrain, Items, ItemId, CheckMsg

# ----
panel_17 = Panel(connection_results.SummaryResults)
panel_18 = Panel(deconstruct_item_result.Name)
panel_19 = Panel(deconstruct_item_result.CheckStatus)
panel_20 = Panel(deconstruct_item_result_2.Name)
panel_21 = Panel(deconstruct_item_result_2.CheckStatus)
panel_22 = Panel(deconstruct_item_result_2.UnityCheck)

# ----
# Local Coordinate System Display
local_coordinate_system = LocalCoordinateSystem(Project=data)  # -> LineOfElements, LocalXVectors, LocalYVectors, LocalZVectors
length_3 = Slider(0.149, range=0..2)
radius_2 = Slider(0.01, range=0..0.01)
point_on_curve = PointOnCurve(local_coordinate_system.LineOfElements, parameter=0.182)

cluster_3 = Cluster(
    num=length_3,
    num_2=radius_2,
    pt=point_on_curve,
    vec_2=local_coordinate_system.LocalXVectors,
    vec=local_coordinate_system.LocalYVectors,
    vec_3=local_coordinate_system.LocalZVectors)  # -> D, C

custom_preview_2 = CustomPreview(Geometry=cluster_3.D, Material=cluster_3.C)

# ==== cluster Cluster
vec = ClusterInput()
vec_2 = ClusterInput()
pt = ClusterInput()
vec_3 = ClusterInput()
num = ClusterInput()
num_2 = ClusterInput()
vec_4 = Vector(vec)
vec_5 = Vector(vec_2)
pt_2 = Point(pt)
vec_6 = Vector(vec_3)
num_3 = Number(num)
num_4 = Number(num_2)
line = LineSDL(Start=pt_2, Direction=vec_5, Length=num_3)
line_2 = LineSDL(Start=pt_2, Direction=vec_4, Length=num_3)
line_3 = LineSDL(Start=pt_2, Direction=vec_6, Length=num_3)
panel = Panel("""255
0
0""")
entwine = Entwine(Branch00=line, Branch01=line_2, Branch02=line_3, FlattenInputs=True)  # -> simplify(Result)
panel_2 = Panel("""0
255
0""")
panel_3 = Panel("""0
0
255""")
rgb = ColourRGB(Alpha=255, Red=panel, Green=panel_2, Blue=panel_3)  # -> graft(Colour)
pipe = Pipe(Curve=entwine, Radius=num_4, Caps=0)
pshift = ShiftPaths(Data=pipe, Offset=-1)
C = ClusterOutput(rgb)
D = ClusterOutput(pshift)

# ==== cluster Cluster_2
G = ClusterInput()
X = ClusterInput()
vec = VectorXYZ(XComponent=X, YComponent=0, ZComponent=0)  # -> Vector, Length
move = Move(Geometry=G, Motion=vec.Vector)  # -> Geometry, Transform
data = Data(move.Geometry)
tstat = TreeStatistics(Tree=data)  # -> Paths, Length, Count
dpath = DeconstructPath(Branch=tstat.Paths)
data_2 = Data(graft(tstat.Length))
flip = FlipMatrix(Data=dpath)
data_3 = ClusterInput()
bang = ExplodeTree(Data=flip)  # -> flatten(Branch0), flatten(Branch1)
data_4 = Data(data_3)
data_5 = Data(graft(bang.Branch0))
data_6 = Data(graft(bang.Branch1))
multiplication = Multiplication(A=bang.Branch0, B=data_4)
multiplication_2 = Multiplication(A=bang.Branch1, B=data_4)
path = ConstructPath(Indices=[data_5, data_6])  # -> flatten(Branch)
vec_2 = VectorXYZ(XComponent=multiplication, YComponent=multiplication_2, ZComponent=0)  # -> Vector, Length
unflatten = UnflattenTree(Tree=vec_2.Vector, Guide=path)  # -> graft(Tree)
data_7 = Data(flatten(data))
dup = DuplicateData(Data=unflatten, Number=data_2, Order=True)  # -> flatten(Data)
move_2 = Move(Geometry=data_7, Motion=dup)  # -> Geometry, Transform
G_2 = ClusterOutput(move_2.Geometry)
panel = Panel(move_2.Geometry)

# ==== cluster Cluster_3
num = ClusterInput()
num_2 = ClusterInput()
line = ClusterInput()
num_3 = ClusterInput()
num_4 = Number(num)
num_5 = Number(num_2)
line_2 = Line(line)
num_6 = Number(num_3)
cluster = Cluster_2(G=line_2, data_3=num_5, X=num_4)
line_3 = Line(cluster)
pipe = Pipe(Curve=line_3, Radius=num_6, Caps=0)  # -> flatten(Pipe)
dom = ConstructDomain(DomainStart="0", DomainEnd="1")
pshift = ShiftPaths(Data=line_2, Offset=-1)
P = ClusterOutput(pipe)
range = Range(Domain=dom, Steps=Slider(8, range=0..100))
lng = ListLength(List=pshift)
data = Data(flatten(lng))
data_2 = Data(range)
c_script = CSharpScript(lengths=data, colorlist=data_2)  # -> out, A; inputs lengths: list of Double, colorlist: list of Double
# ---------- c_script: C# ----------
    DataTree<double> tree = new DataTree<double>();
    GH_Path path = new GH_Path();
    int w = 0;


    for (int b = 0; b < lengths.Count; b++)
    {
      for (int c = 0;c < lengths[b];c++)
      {
        double num = colorlist[(w % colorlist.Count)];
        //tree.Add(num, path);
        tree.Add(num);
      }
      w = w + 1;

    }
    A = tree;
# ---------- end c_script ----------
data_3 = Data(flatten(c_script.A))
gradient = Gradient(
    LowerLimit=0,
    UpperLimit=1,
    Parameter=data_3,
    stops=[0: RGB(35, 99, 187), 0: RGB(234, 38, 0), 0: RGBA(255, 255, 255, 0), 0.25: RGB(234, 126, 0), 0.5: RGB(254, 244, 84), 0.75: RGB(173, 203, 249)])
lng_2 = ListLength(List=gradient)
dup = DuplicateData(Data=" (100)", Number=lng_2, Order=True)  # -> flatten(Data)
merge = Merge(Data1=graft(gradient), Data2=graft(dup))
join = TextJoin(Text=merge)  # -> flatten(Result)
R = ClusterOutput(join)
